# Grasshopper definition Pangolin Pendant Rough Dim 2.gh (Grasshopper 1.0.7)
# plug-ins: LunchBox

# ---- group: RH_IN: Gap
gap = Slider(1, range=1..3)

# ---- group: RH_IN:Height
height = Slider(14, range=10..18)

# ---- group: RH_IN:Diameter
diameter = Slider(12, range=0..24)

# ----
center_of_bulbpt = Point(Point(0, 0, 0))

# ---- group: RH:IN:Flip
flip_direction = BooleanToggle(True)

# ----
Z = UnitZ(Factor=-46)
in_to_mm = Multiplication(A=gap, B=25.4)
in_to_mm_2 = Multiplication(A=height, B=25.4)
in_to_mm_3 = Multiplication(A=diameter, B=25.4)
num = Number(3)
center_of_bulb_point = Move(Geometry=center_of_bulbpt, Motion=Z)  # -> Geometry, Transform
divide_by_2 = Division(A=in_to_mm_2, B=2)
divide_by_2_2 = Division(A=in_to_mm_3, B=2)
circle = CircleCNR(Center=center_of_bulb_point.Geometry, Normal=Vector(0, 0, 1), Radius=divide_by_2_2)
len = Length(Curve=circle)
division = Division(A=len, B=180)
expression = Expression(x=division, y=num, Expression="y*Round(x/y)")
division_2 = Division(A=360, B=expression)
addition = Addition(A=division_2, B=5)
rad = Radians(Degrees=addition)
rad_2 = Radians(Degrees=division_2)
Z_2 = UnitZ(Factor=divide_by_2)
neg = Negative(Value=Z_2)
phi = GoldenRatio(Factor=1)
series = Series(Start=-1, Step=-1, Count=3)
series_2 = Series(Start=0, Step=rad_2, Count=expr("x", expression))
move = Move(Geometry=center_of_bulb_point.Geometry, Motion=[Z_2, neg])  # -> Geometry, Transform
pow = Power(A=phi, B=series)
Z_3 = UnitZ(Factor=-25.4)
ins = InsertItems(List=reverse(pow), Item=[0, 1], Indices=[0, 3], Wrap=False)  # -> reverse(List)
move_2 = Move(Geometry=move.Geometry, Motion=Z_3)  # -> Geometry, Transform
item = ListItem(List=move_2.Geometry, Index=1, Wrap=True)
item_2 = ListItem(List=move_2.Geometry, Index=0, Wrap=True)
rev = ReverseList(List=ins)
filter = StreamFilter(Gate=flip_direction, Stream0=ins, Stream1=rev)
merge = Merge(Data1=item, Data2=center_of_bulbpt, Data3=item_2)
arc = Arc(Plane=merge, Radius=divide_by_2_2, Angle=rad)  # -> Arc, Length
divide = DivideCurve(Curve=arc.Arc, Count=4, Kinks=False)  # -> Points, Tangents, Parameters
vec2pt = Vector2Pt(PointA=divide.Points, PointB=graft(merge), Unitize=False)  # -> Vector, Length
line = LineSDL(Start=divide.Points, Direction=vec2pt.Vector, Length=in_to_mm)
eval = EvaluateCurve(Curve=line, Parameter=filter)  # -> Point, Tangent, Angle
viewer = ParamViewer(eval.Point)
item_3 = ListItem(List=viewer, Index=0, Wrap=True)  # -> Item, Item1, Item2
branch = TreeBranch(Tree=eval.Point, Path=item_3.Item, MaintainPaths=True)
branch_2 = TreeBranch(Tree=eval.Point, Path=item_3.Item2, MaintainPaths=True)
branch_3 = TreeBranch(Tree=eval.Point, Path=item_3.Item1, MaintainPaths=True)
scale = Scale(Geometry=branch, Center=item, Factor=Slider(0.843, range=0..1))  # -> Geometry, Transform
scale_2 = Scale(Geometry=branch_2, Center=item_2, Factor=Slider(0.445, range=0..1))  # -> Geometry, Transform
scale_3 = Scale(Geometry=branch_3, Center=item_2, Factor=Slider(1, range=0..1))  # -> Geometry, Transform
arc_2 = Arc3Pt(PointA=scale_2.Geometry, PointB=scale_3.Geometry, PointC=scale.Geometry)  # -> Arc, Plane, Radius
intcrv = Interpolate(Vertices=[scale.Geometry, branch_3, scale_2.Geometry], Degree=3, Periodic=False, KnotStyle=1)  # -> Curve, Length, Domain
loft = Loft(Curves=arc_2.Arc, Options={Adjust=False, Closed=False, LoftEnds=0, LoftSimp=0, LoftType=0, Rebuild=10, Refit=0.01})
rotate = Rotate(Geometry=loft, Angle=series_2, Plane=PlaneXY(0, 0, 0))  # -> simplify(Geometry), Transform
# ADD TRI B AND CULL TO SEE IF STILL WORKS
trib = TrianglePanelsB(Surface=rotate.Geometry, UDivisions=1, VDivisions=5)
cull_i = CullIndex(List=trib, Indices=[0, 5], Wrap=True)
mesh = MeshBrep(
    Brep=cull_i,
    Settings={GridMaxCount=0, GridMinCount=16, JaggedSeams=False, MaxEdgeLength=0, MinEdgeLength=0.0001, MinTolerance=0, Refine=True, RefineAngle=0, RelativeTolerance=0.65, SimplePlanes=True, Tolerance=0})

# ---- group: RH_OUT:Geometry
python = GhPythonScript(x=mesh)  # -> out, a; inputs x: Mesh
# ---------- python: Python ----------
import json
import Rhino.Geometry as rg

mesh = x

verts = []
for v in mesh.Vertices:
    verts.append([float(v.X), float(v.Y), float(v.Z)])

face_list = []
for f in mesh.Faces:
    if f.IsQuad:
        face_list.append([int(f.A), int(f.B), int(f.C), int(f.D)])
    else:
        face_list.append([int(f.A), int(f.B), int(f.C), int(f.C)])

a = json.dumps({"v": verts, "f": face_list})
# ---------- end python ----------
